# Grasshopper definition GD.gh (Grasshopper 1.0.8)
# plug-ins: KohonenMapper, GH_DesignMate

maxheight = Slider(40, range=0..100)

roofgardenbool = Slider(0, range=0..1)
numfloors = Slider(5, range=1..10)
facadetype = Slider(2, range=0..4)
setback = Slider(5, range=0..8)

numfloors_2 = Slider(1, range=1..10)
facadetype_2 = Slider(0, range=0..4)
setback_2 = Slider(1, range=0..8)
roofgardenbool_2 = Slider(0, range=0..1)

roofgardenbool_3 = Slider(1, range=0..1)
numfloors_3 = Slider(3, range=1..10)
setback_3 = Slider(3, range=0..8)
facadetype_3 = Slider(1, range=0..4)

roofgardenbool_4 = Slider(0, range=0..1)
numfloors_4 = Slider(10, range=1..10)
facadetype_4 = Slider(3, range=0..4)
setback_4 = Slider(3, range=0..8)

brep = Brep(<brep referenced from the Rhino model>)
brep_2 = Brep(<brep referenced from the Rhino model>)
brep_3 = Brep(<brep referenced from the Rhino model>)
brep_4 = Brep(<brep referenced from the Rhino model>)
brep_5 = Brep(<brep referenced from the Rhino model>)
brep_6 = Brep(<brep referenced from the Rhino model>)

floormaker = CreateFloors(Windows=brep, Walls=brep_2, Columns=brep_3, Slabs=brep_4, Ceilings=brep_6, Beams=brep_5)
c_script = CSharpScript(
    data=[numfloors_2, setback_2, facadetype_2, roofgardenbool_2, numfloors_3, setback_3, facadetype_3, roofgardenbool_3, numfloors, setback, facadetype, roofgardenbool, numfloors_4, setback_4, facadetype_4, roofgardenbool_4],
    numFeatures=Slider(4, range=0..10))  # -> out, a; inputs data: list of Double, numFeatures: Int32
# ---------- c_script: C# ----------
// Grasshopper Script Instance
#region Usings
using System;
using System.Linq;
using System.Collections;
using System.Collections.Generic;
using System.Drawing;

using Rhino;
using Rhino.Geometry;

using Grasshopper;
using Grasshopper.Kernel;
using Grasshopper.Kernel.Data;
using Grasshopper.Kernel.Types;
#endregion

public class Script_Instance : GH_ScriptInstance
{
    #region Notes
    /* 
      Members:
        RhinoDoc RhinoDocument
        GH_Document GrasshopperDocument
        IGH_Component Component
        int Iteration

      Methods (Virtual & overridable):
        Print(string text)
        Print(string format, params object[] args)
        Reflect(object obj)
        Reflect(object obj, string method_name)
    */
    #endregion

    private void RunScript(List<double> data, int numFeatures, ref object a)
    {
        var tree = new DataTree<double>();
        GH_Path path;
        int legge = data.Count / numFeatures;
        int counter = 0;

        for (int i = 0; i < legge; i++)
        {
            path = new GH_Path(i);
            for (int j = 0; j < numFeatures; j++)
            {
                tree.Add(data[counter], path);
                counter++;
            }
        }
        a = tree;
    }
}
# ---------- end c_script ----------

# ---- group: 1. Set to false
toggle = BooleanToggle(False)

# ---- group: check data structure
panel = Panel(c_script.a)

# ---- group: 2. Enable timer
timer = Timer(Interval=20, TimerInterval=20, Target=kohonen_map)  # disabled

# ----
bool = Boolean(roofgardenbool_2)
panel_2 = Panel(bool)
kohonen_map = KohonenMap(
    Reset=toggle,
    XMap=Slider(12, range=0..100),
    YMap=Slider(8, range=0..100),
    Space=Slider(30, range=0..100),
    Inputs=c_script.a,
    WinLearn="0.95",
    Learn="0.9",
    WinLearnDecay="0.999",
    LearnDecay="0.998",
    NeighDecay=0.99,
    NeighRad=Slider(0.6, range=0..1),
    Seed=Slider(61, range=0..100))  # -> Coverged, Counter, Locations, Synaptics, Neigh, InputLocations
pt = Point(kohonen_map.Locations)
item = ListItem(List=kohonen_map.Synaptics, Index=0, Wrap=True)  # -> Item, Item1, Item2, Item3
round = Round(Number=item.Item)  # -> Nearest, Floor, Ceiling
round_2 = Round(Number=item.Item1)  # -> Nearest, Floor, Ceiling
round_3 = Round(Number=item.Item2)  # -> Nearest, Floor, Ceiling
round_4 = Round(Number=item.Item3)  # -> Nearest, Floor, Ceiling
generategeomcomp = GenerateGeomComp(
    NumberOfFloors=round.Floor,
    SetbackM=round_2.Floor,
    FacadeType=round_3.Floor,
    AddRoofGarden=round_4.Floor,
    FloorList=floormaker,
    FtF=Slider(4, range=0..10))  # -> Walls, Columns, Slabs, Ceilings, Windows, Beams
vec = Vector(kohonen_map.Locations)
brep_7 = Brep([generategeomcomp.Walls, generategeomcomp.Columns, generategeomcomp.Slabs, generategeomcomp.Ceilings, generategeomcomp.Windows, generategeomcomp.Beams])
panel_3 = Panel(brep_7)
move = Move(Geometry=brep_7, Motion=vec)  # -> Geometry, Transform
