# Grasshopper definition DesignMate.gh (Grasshopper 1.0.7)

# ---- group: RH_IN:Length
branch_length = Slider(10, range=0..10)

# ---- group: RH_IN:Radius
cell_radius = Slider(10, range=0..10)

# ---- group: RH_IN:Count
number_slider = Slider(100, range=1..100)

# ----
columns = Brep([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])
vertical_circulation = Brep([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])
ground_plane = Brep(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)
slabs = Brep([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])
mesh = Mesh(columns)
mesh_2 = Mesh(vertical_circulation)
mesh_3 = Mesh(ground_plane)
mesh_4 = Mesh(slabs)
X = UnitX(Factor=expr("-x", 1))
Y = UnitY(Factor=1)
xz = XZPlane(Origin=Point(0, 0, 0))
mcol = MeshColours(Mesh=mesh_4, Colours=ColourSwatch(SwatchColor=RGB(38, 149, 178)))
mcol_2 = MeshColours(Mesh=mesh, Colours=ColourSwatch(SwatchColor=RGB(93, 75, 69)))
mcol_3 = MeshColours(Mesh=mesh_2, Colours=ColourSwatch(SwatchColor=RGB(21, 167, 136)))
mcol_4 = MeshColours(Mesh=mesh_3, Colours=ColourSwatch(SwatchColor=RGB(244, 240, 248)))
pl = ConstructPlane(Origin=Point(0, 0, 0), XAxis=X, YAxis=Y)
mjoin = MeshJoin(Meshes=mcol)
mjoin_2 = MeshJoin(Meshes=mcol_4)
mjoin_3 = MeshJoin(Meshes=mcol_2)
mjoin_4 = MeshJoin(Meshes=mcol_3)
orient = Orient(Geometry=mjoin, Source=pl, Target=xz)  # -> Geometry, Transform
orient_2 = Orient(Geometry=mjoin_3, Source=pl, Target=xz)  # -> Geometry, Transform
orient_3 = Orient(Geometry=mjoin_2, Source=pl, Target=xz)  # -> Geometry, Transform
orient_4 = Orient(Geometry=mjoin_4, Source=pl, Target=xz)  # -> Geometry, Transform
c_script = CSharpScript(mesh=orient.Geometry)  # -> base64Draco; inputs mesh: Mesh
# ---------- c_script: C# ----------
    var options = new Rhino.FileIO.DracoCompressionOptions();
    options.CompressionLevel = 5;
    options.IncludeTextureCoordinates = false;
    options.IncludeVertexColors = false;

    var compressed = Rhino.FileIO.DracoCompression.Compress(mesh, options);
    base64Draco = compressed.ToBase64String();
# ---------- end c_script ----------
c_script_2 = CSharpScript(mesh=orient_2.Geometry)  # -> base64Draco; inputs mesh: Mesh; same code as c_script
c_script_3 = CSharpScript(mesh=orient_4.Geometry)  # -> base64Draco; inputs mesh: Mesh; same code as c_script
c_script_4 = CSharpScript(mesh=orient_3.Geometry)  # -> base64Draco; inputs mesh: Mesh; same code as c_script

# ---- group: RH_OUT:Mesh_Slabs
txt = Text(c_script)

# ---- group: RH_OUT:Mesh_Columns
txt_2 = Text(c_script_2)

# ---- group: RH_OUT:Mesh_VerticalCirculation
txt_3 = Text(c_script_3)

# ---- group: RH_OUT:Mesh_Ground
txt_4 = Text(c_script_4)
